# Dynamo graph Definition.dyn (Dynamo 1.2.3.592)

file_path = Filename("..\..\..\..\..\..\Program%20Files\Oasys\GSA%208.7\Samples\Steel\Steel_Design_Complex.gwb")
openGsaModel = DesignLink.gsaInteraction.OpenGsaModel(file_path)
getGsaElements = DesignLink.gsaInteraction.GetGsaElements(openGsaModel)
byStartPointEndPoint = Line.ByStartPointEndPoint(startPoint=getGsaElements.out4, endPoint=getGsaElements.out6)
code_block = CodeBlock { 1000; }
scale = Geometry.Scale(geometry=byStartPointEndPoint, amount=code_block)
length = Curve.Length(scale)
code_block_2 = CodeBlock(s=getGsaElements.out7) { s; }
code_block_3 = CodeBlock { " "; }
split = String.Split(code_block_2, code_block_3)
code_block_4 = CodeBlock { 2; }
getItemAtIndex = List.GetItemAtIndex(list=split@L2, index=code_block_4)

# group: RETRIEVE THE SELECTED BEAM
python_script = Python()
# ---------- python_script.python (22 lines) ----------
import clr
clr.AddReference('ProtoGeometry')
from Autodesk.DesignScript.Geometry import *

# Import RevitAPI
clr.AddReference("RevitAPI")
import Autodesk
from Autodesk.Revit.DB import *

# Import RevitAPI
clr.AddReference("RevitServices")
import RevitServices
from RevitServices.Persistence import DocumentManager

#The inputs to this node will be stored as a list in the IN variables.
doc = DocumentManager.Instance.CurrentDBDocument
cat = doc.Settings.Categories

collector = FilteredElementCollector(doc).OfCategory(BuiltInCategory.OST_StructuralFraming)

#Assign your output to the OUT variable.
OUT = [i for i in collector]
# ----------------------------------------
name = Family.Name(python_script)
bv_remove_nulls = Custom[bv Remove Nulls](List=name)  # forked from Lunchbox
code_block_5 = CodeBlock { 1; }
contains = String.Contains(str=bv_remove_nulls, searchFor=getItemAtIndex, ignoreCase=code_block_5)
filterByBoolMask = List.FilterByBoolMask(list=python_script, mask=contains)
